# Grasshopper definition Harbourside Canopy.gh (Grasshopper 1.0.8)

column_location = Panel("""2
10
22""")
cluster = Cluster(
    tor_level=Slider(6.85, range=0..10),
    canopy_width=Slider(14.4, range=0..100),
    canopy_length=Slider(31, range=0..100),
    maximum_sag=Slider(4, range=0..10),
    minimum_sag=Slider(1.5, range=0..10),
    joist_no=Slider(24, range=0..100),
    joist_profile_x=Slider(0.1, range=0.1..1),
    joist_profile_z=Slider(0.3, range=0..1),
    beam_joist_connection=Slider(0.15, range=0..1),
    beam_no=Slider(6, range=0..10),
    beam_profile_x=Slider(0.2, range=0..1),
    beam_profile_z=Slider(0.4, range=0..1),
    column_radius=Slider(0.15, range=0..1),
    column_location=column_location,
    roof_finish_thickness=Slider(0.1, range=0.1..1))  # -> beam_geometry, beam_fabrication_geometry, joist_geometry, column_geometry, roof_finish

# ==== cluster Cluster
tor_level = ClusterInput()
canopy_width = ClusterInput()
canopy_length = ClusterInput()
maximum_sag = ClusterInput()
minimum_sag = ClusterInput()
joist_no = ClusterInput()
joist_profile_x = ClusterInput()
joist_profile_z = ClusterInput()
beam_joist_connection = ClusterInput()
beam_no = ClusterInput()
beam_profile_x = ClusterInput()
beam_profile_z = ClusterInput()
column_radius = ClusterInput()
column_location = ClusterInput()  # Panel Input
roof_finish_thickness = ClusterInput()

# ---- group: CURVE ONE FORMATION
subtraction = Subtraction(A=joist_no, B="1")
unit_x = UnitX(Factor=1)
division = Division(A="1", B=subtraction)
construct_point = ConstructPoint(XCoordinate=0, YCoordinate=0, ZCoordinate=tor_level)
line_sdl = LineSDL(Start=construct_point, Direction=unit_x, Length=canopy_width)
divide_curve = DivideCurve(Curve=line_sdl, Count=expr("x-1", joist_no), Kinks=False)  # -> Points, Tangents, Parameters
series = Series(Start=0, Step=division, Count=joist_no)
graph_mapper = GraphMapper(
    series,
    x0=1,
    x1=0,
    y0=1,
    y1=0,
    container_name="Bezier",
    cpx=[0, 0.5763807893, 0.5441107154, 1],
    cpy=[1, 1, 0.5783624649, 1])
unit_z = UnitZ(Factor=graph_mapper)
sort_list = SortList(Keys=graph_mapper)  # -> reverse(Keys), ValuesValuesA
reverse = Reverse(Vector=unit_z)
list_item = ListItem(List=sort_list.Keys, Index="1", Wrap=True)
division_2 = Division(A=maximum_sag, B=list_item)
multiplication = Multiplication(A=reverse, B=division_2)
move = Move(Geometry=divide_curve.Points, Motion=multiplication)  # -> Geometry, Transform
interpolate = Interpolate(Vertices=move.Geometry, Degree=3, Periodic=False, KnotStyle=1)  # -> Curve, Length, Domain

# ---- group: CURVE TWO FORMATION
unit_x_2 = UnitX(Factor=1)
construct_point_2 = ConstructPoint(XCoordinate=0, YCoordinate=canopy_length, ZCoordinate=tor_level)
line_sdl_2 = LineSDL(Start=construct_point_2, Direction=unit_x_2, Length=canopy_width)
divide_curve_2 = DivideCurve(Curve=line_sdl_2, Count=expr("x-1", joist_no), Kinks=False)  # -> Points, Tangents, Parameters
graph_mapper_2 = GraphMapper(
    series,
    x0=1,
    x1=0,
    y0=1,
    y1=0,
    container_name="Bezier",
    cpx=[0, 0.5763807893, 0.5014756918, 1],
    cpy=[1, 1, 0.8852238059, 1])
unit_z_2 = UnitZ(Factor=graph_mapper_2)
sort_list_2 = SortList(Keys=graph_mapper_2)  # -> Keys, ValuesValuesA
reverse_2 = Reverse(Vector=unit_z_2)
reverse_list = ReverseList(List=sort_list_2.Keys)
list_item_2 = ListItem(List=reverse_list, Index="1", Wrap=True)
division_3 = Division(A=minimum_sag, B=list_item_2)
multiplication_2 = Multiplication(A=reverse_2, B=division_3)
move_2 = Move(Geometry=divide_curve_2.Points, Motion=multiplication_2)  # -> Geometry, Transform
interpolate_2 = Interpolate(Vertices=move_2.Geometry, Degree=3, Periodic=False, KnotStyle=1)  # -> Curve, Length, Domain

# ---- group: LOFT
loft = Loft(
    Curves=[interpolate.Curve, interpolate_2.Curve],
    Options={Adjust=False, Closed=False, LoftEnds=0, LoftSimp=0, LoftType=0, Rebuild=10, Refit=0.01})

# ---- group: JOISTS PROJECTION ON SURFACE
rectangle = Rectangle(Plane=PlaneXY(0, 0, 0), XSize=canopy_width, YSize=canopy_length, Radius=0)  # -> Rectangle, Length
surface = Surface(rectangle.Rectangle)
divide_surface = DivideSurface(Surface=surface, UCount=joist_no, VCount=beam_no)  # -> Points, Normals, Parameters
interpolate_3 = Interpolate(Vertices=divide_surface.Points, Degree=3, Periodic=False, KnotStyle=1)  # -> Curve, Length, Domain
unit_z_3 = UnitZ(Factor=1)
flatten_tree = FlattenTree(Tree=interpolate_3.Curve, Path="{0}")
project_curve = ProjectCurve(Curve=flatten_tree, Brep=loft, Direction=unit_z_3)

# ---- group: ROOF FINISH
unit_z_4 = UnitZ(Factor=1)
addition = Addition(A=joist_profile_z)
amplitude = Amplitude(Vector=unit_z_4, Amplitude=addition)
move_3 = Move(Geometry=loft, Motion=amplitude)  # -> Geometry, Transform
unit_z_5 = UnitZ(Factor=roof_finish_thickness)
extrude = Extrude(Base=move_3.Geometry, Direction=unit_z_5)
roof_finish = ClusterOutput(extrude)

# ---- group: JOIST GEOMETRY
divide_curve_3 = DivideCurve(Curve=project_curve, Count=expr("x-1", beam_no), Kinks=False)  # -> Points, Tangents, Parameters
cull_index = CullIndex(List=divide_curve_3.Points, Indices="-1", Wrap=True)
xz_plane = XZPlane(Origin=cull_index)
rectangle_2 = Rectangle(Plane=xz_plane, XSize=joist_profile_x, YSize=joist_profile_z, Radius=0)  # -> Rectangle, Length
md_slider = MDSlider(
    SliderMode=0,
    slider_value=Point(0.4979400635, 0.499168396, 0.5),
    x_domain=Domain(0, 1),
    y_domain=Domain(0, 1),
    z_domain=Domain(0, 1))
evaluate_surface = EvaluateSurface(Surface=reparameterize(rectangle_2.Rectangle), Point=md_slider)  # -> Point, Normal, UDirection, VDirection, Frame
vector_2pt = Vector2Pt(PointA=evaluate_surface.Point, PointB=cull_index, Unitize=False)  # -> Vector, Length
shatter = Shatter(Curve=project_curve, Parameters=divide_curve_3.Parameters)
move_4 = Move(Geometry=rectangle_2.Rectangle, Motion=vector_2pt.Vector)  # -> Geometry, Transform
extrude_along = ExtrudeAlong(Base=move_4.Geometry, Curve=shatter)  # -> simplify(Extrusion)
unit_z_6 = UnitZ(Factor=beam_joist_connection)
move_5 = Move(Geometry=extrude_along, Motion=unit_z_6)  # -> Geometry, Transform
cap_holes = CapHoles(Brep=move_5.Geometry)
joist_geometry = ClusterOutput(cap_holes)

# ----
unit_z_7 = UnitZ(Factor=beam_joist_connection)
move_6 = Move(Geometry=shatter, Motion=unit_z_7)  # -> Geometry, Transform

# ---- group: BEAM GEOMETRY
flip_matrix = FlipMatrix(Data=divide_curve_3.Points)
unit_z_8 = UnitZ(Factor=1)
interpolate_4 = Interpolate(Vertices=flip_matrix, Degree=Slider(2, range=0..10), Periodic=False, KnotStyle=1)  # -> Curve, Length, Domain
reverse_3 = Reverse(Vector=unit_z_8)
amplitude_2 = Amplitude(Vector=reverse_3, Amplitude=beam_profile_z)
unit_y = UnitY(Factor=1)
division_4 = Division(A=beam_profile_x, B=Slider(2, range=0..10))
extrude_2 = Extrude(Base=interpolate_4.Curve, Direction=amplitude_2)
negative = Negative(Value=division_4)
amplitude_3 = Amplitude(Vector=unit_y, Amplitude=negative)
unit_y_2 = UnitY(Factor=1)
amplitude_4 = Amplitude(Vector=unit_y_2, Amplitude=beam_profile_x)
move_7 = Move(Geometry=extrude_2, Motion=amplitude_3)  # -> Geometry, Transform
extrude_3 = Extrude(Base=move_7.Geometry, Direction=amplitude_4)
beam_geometry = ClusterOutput(extrude_3)

# ---- group: COLUMN GEOMETRY
unit_z_9 = UnitZ(Factor=1)
list_item_3 = ListItem(List=flip_matrix, Index=column_location, Wrap=True)
reverse_4 = Reverse(Vector=unit_z_9)
deconstruct = Deconstruct(Point=list_item_3)  # -> XComponent, YComponent, ZComponent
line_sdl_3 = LineSDL(Start=list_item_3, Direction=reverse_4, Length=deconstruct.ZComponent)
pipe = Pipe(Curve=line_sdl_3, Radius=column_radius, Caps=Toggle(True))
column_geometry = ClusterOutput(pipe)

# ---- group: Plane Orientation for Beams Fabrication
volume = Volume(Geometry=extrude_3)  # -> Volume, Centroid
deconstruct_brep = DeconstructBrep(Brep=extrude_3)  # -> Faces, Edges, Vertices
list_item_4 = ListItem(List=deconstruct_brep.Faces, Index=0, Wrap=True)
flatten_tree_2 = FlattenTree(Tree=list_item_4, Path="{0}")
list_length = ListLength(List=flatten_tree_2)
series_2 = Series(Start="0", Step=Slider(2, range=0..10), Count=list_length)
md_slider_2 = MDSlider(
    SliderMode=0,
    slider_value=Point(0.4130859375, 0.8948144913, 0.5),
    x_domain=Domain(0, 1),
    y_domain=Domain(0, 1),
    z_domain=Domain(0, 1))
construct_point_3 = ConstructPoint(XCoordinate=Slider(-5, range=-15..0), YCoordinate=series_2, ZCoordinate=0)
evaluate_surface_2 = EvaluateSurface(Surface=reparameterize(list_item_4), Point=md_slider_2)  # -> Point, Normal, UDirection, VDirection, Frame
xy_plane = XYPlane(Origin=construct_point_3)
rotate_plane = RotatePlane(Plane=evaluate_surface_2.Frame, Angle=degrees(Slider(90, range=0..100)))
orient = Orient(Geometry=extrude_3, Source=rotate_plane, Target=graft(xy_plane))  # -> Geometry, Transform
beam_fabrication_geometry = ClusterOutput(orient.Geometry)

# ---- group: Weight Calculation
s275_weight_in_kg_m3 = Slider(7850, range=0..10000)
_15_solid_ratio = Slider(0.15, range=0..1)
expression = Expression(
    Volume=volume.Volume,
    Weight=s275_weight_in_kg_m3,
    ProfileSolidRatio=_15_solid_ratio,
    Expression="Volume*Weight*ProfileSolidRatio")

# ---- group: Labels for Fabrication
char_sequence = CharSequence(Count=list_length, CharPool="ABCDEFGHIJKLMNOPQRSTUVWXYZ", Format="{0}")
concatenate = Concatenate(C="Beam ", Fragment_A=char_sequence, Fragment_B="  W: ", A=expression, B="kg")
text_tag_3d = TextTag3D(Location=xy_plane, Text=concatenate, Size=Slider(0.1, range=0..0.1), Justification=7)
